# Dynamo graph AdaptiveComponentByCurve.dyn (Dynamo 1.0.1.1803)

code_block = CodeBlock { {0..1..#10}; }
select_model_element = DSModelElementSelection()
curve = CurveElement.Curve(select_model_element, lacing=Longest)
family_types = FamilyTypes("Level Head - Target:1/4\"")
byParametersOnCurveReference = AdaptiveComponent.ByParametersOnCurveReference(code_block, curve, family_types, lacing=Longest)
flatten = Flatten(byParametersOnCurveReference)
