# Dynamo graph MAGN-438_structuralFraming_simple.dyn (Dynamo 1.0.1.1803)

number = DoubleInput(0..50..10)
byCoordinates = Point.ByCoordinates(x=number, lacing=Longest)
number_2 = DoubleInput(10..20..#6)
byCoordinates_2 = Point.ByCoordinates(y=number_2, lacing=Longest)
asVector = Point.AsVector(byCoordinates_2)
add = Point.Add(point=byCoordinates, vectorToAdd=asVector, lacing=Longest)
byStartPointEndPoint = Line.ByStartPointEndPoint(startPoint=add, endPoint=byCoordinates, lacing=Longest)
code_block = CodeBlock { 1; }
byElevation = Level.ByElevation(code_block)
ZAxis = Vector.ZAxis()
asPoint = Vector.AsPoint(ZAxis, lacing=Longest)
beam = StructuralType.Beam()
structural_framing_types = StructuralFramingTypes("No structural framing types available.")
byCurveLevelUpVectorAndType = StructuralFraming.ByCurveLevelUpVectorAndType(byStartPointEndPoint, byElevation, asPoint, beam, structural_framing_types)
watch = Watch(byCurveLevelUpVectorAndType)
string = StringInput("Cut Length")
getParameterValueByName = Element.GetParameterValueByName(element=byCurveLevelUpVectorAndType, parameterName=string, lacing=Longest)
