# Dynamo graph MAGN_102_projectPointsToFace_selfContained.dyn (Dynamo 1.0.1.1803)

number = DoubleInput(0..100..#3)
number_2 = DoubleInput(-100.000..100..#2)
number_3 = DoubleInput(50)
byCoordinates = Point.ByCoordinates(x=number, y=number_2, z=number_3, lacing=Longest)
byBestFitThroughPoints = Plane.ByBestFitThroughPoints(byCoordinates, lacing=Longest)
number_4 = DoubleInput(0..10)
byCoordinates_2 = Point.ByCoordinates(x=number_4, lacing=Longest)
closestPointTo = Geometry.ClosestPointTo(geometry=byBestFitThroughPoints, other=byCoordinates_2, lacing=Longest)
watch = Watch(closestPointTo)
distanceTo = Geometry.DistanceTo(geometry=closestPointTo, other=byCoordinates_2)
watch_2 = Watch(distanceTo)
watch_3d = Watch3D(byCoordinates)
UVParameterAtPoint = Surface.UVParameterAtPoint(byBestFitThroughPoints, closestPointTo)
watch_3 = Watch(UVParameterAtPoint)
