# Dynamo graph LacingTest.dyn (Dynamo 1.0.1.1803)

number = DoubleInput(0)
number_2 = DoubleInput(3)
number_3 = DoubleInput(1)
range = Range(start=number, end=number_2, step=number_3, lacing=Longest)
number_4 = DoubleInput(4)
range_2 = Range(start=number, end=number_4, step=number_3, lacing=Longest)
byCoordinates = Point.ByCoordinates(x=number, y=range, z=range_2, lacing=Longest)
byPoint = ReferencePoint.ByPoint(byCoordinates, lacing=Longest)
count = List.Count(byPoint, lacing=Longest)
watch = Watch(count)
