# Dynamo graph ClosedCurve.dyn (Dynamo 1.0.1.1803)

byCoordinates = Point.ByCoordinates(lacing=Longest)
number = DoubleInput(20)
byCenterPointRadius = Circle.ByCenterPointRadius(centerPoint=byCoordinates, radius=number, lacing=Longest)
geometry = Element.Geometry(byCenterPointRadius)
number_2 = DoubleInput(0)
pointAtParameter = Curve.PointAtParameter(curve=geometry, param=number_2, lacing=Longest)
parameterAtPoint = Curve.ParameterAtPoint(curve=byCenterPointRadius, point=pointAtParameter)
geometry_2 = Element.Geometry(byCenterPointRadius)
PI = Math.PI()
pointAtParameter_2 = Curve.PointAtParameter(curve=geometry_2, param=PI, lacing=Longest)
parameterAtPoint_2 = Curve.ParameterAtPoint(curve=byCenterPointRadius, point=pointAtParameter_2)
trimByParameter = Curve.TrimByParameter(byCenterPointRadius, parameterAtPoint, parameterAtPoint_2, lacing=Longest)
parameterAtPoint_3 = Curve.ParameterAtPoint(curve=byCenterPointRadius, point=pointAtParameter_2)
parameterAtPoint_4 = Curve.ParameterAtPoint(curve=byCenterPointRadius, point=pointAtParameter)
trimByParameter_2 = Curve.TrimByParameter(byCenterPointRadius, parameterAtPoint_3, parameterAtPoint_4, lacing=Longest)
create_list = List.Create(trimByParameter, trimByParameter_2)
byJoinedCurves = PolyCurve.ByJoinedCurves(create_list, lacing=Longest)
create_list_2 = List.Create(byJoinedCurves)
number_3 = DoubleInput(1)
byCoordinates_2 = Point.ByCoordinates(x=number_2, y=number_2, z=number_3, lacing=Longest)
coordinateSystemAtParameter = Curve.CoordinateSystemAtParameter(byCenterPointRadius, number_2, lacing=Longest)
transform = Geometry.Transform(byCoordinates_2, coordinateSystemAtParameter, lacing=Longest)
asVector = Point.AsVector(transform)
extrudeAsSolid = Curve.ExtrudeAsSolid(curve=create_list_2, direction=asVector, distance=PI, lacing=Longest)
watch = Watch(extrudeAsSolid)
