# Dynamo graph CurveByPointsByLine.dyn (Dynamo 1.0.1.1803)

byCoordinates = Point.ByCoordinates(lacing=Longest)
number = DoubleInput(2)
number_slider = DoubleSlider(8.764, range=0..10 step 0.1)
byCoordinates_2 = Point.ByCoordinates(x=number, y=number_slider, z=number, lacing=Longest)
byStartPointEndPoint = Line.ByStartPointEndPoint(startPoint=byCoordinates, endPoint=byCoordinates_2, lacing=Longest)
byCurve = ModelCurve.ByCurve(byStartPointEndPoint, lacing=Longest)
