# Dynamo graph CurvebyPointsEllipse.dyn (Dynamo 1.0.1.1803)

byCoordinates = Point.ByCoordinates(lacing=Longest)
ZAxis = Vector.ZAxis()
byOriginNormal = Plane.ByOriginNormal(origin=byCoordinates, normal=ZAxis)
number = DoubleInput(30)
number_2 = DoubleInput(50)
number_3 = DoubleInput(0)
radiansToDegrees = Math.RadiansToDegrees(number_3)
number_4 = DoubleInput(2)
sub = number_4 - number_3
radiansToDegrees_2 = Math.RadiansToDegrees(sub)
byPlaneRadiiAngles = EllipseArc.ByPlaneRadiiAngles(byOriginNormal, number, number_2, radiansToDegrees, radiansToDegrees_2, lacing=Longest)
byCurve = ModelCurve.ByCurve(byPlaneRadiiAngles, lacing=Longest)
