# Dynamo graph DividedSurface.dyn (Dynamo 1.0.1.1803)

select_face = DSFaceSelection()
number = DoubleInput(5)
byFaceAndUVDivisions = DividedSurface.ByFaceAndUVDivisions(select_face, number, number, lacing=Longest)
