# Dynamo custom node CustomRound.dyf "Round To Precision" (Dynamo 1.0.1.1803)
# category: CAAD_RWTH.Math
# Rounds a number to a specified precision

Number = Input()
Precision = Input()
formula = Formula("Round(a/b,0)*b", a=Number, b=Precision, lacing=Longest)
round = Output(formula)
