# Dynamo custom node GetHighest.dyf "Get Highest" (Dynamo 1.0.1.1803)
# category: CAAD_RWTH.Lists
# Gets the highest value from a list

list = Input()
sort = List.Sort(list)
reverse = List.Reverse(sort)
firstItem = List.FirstItem(reverse)
highest = Output(firstItem)
