# Dynamo custom node GetLowest.dyf "Get Lowest" (Dynamo 1.0.1.1803)
# category: CAAD_RWTH.Lists
# Gets the lowest value from a list

list = Input()
sort = List.Sort(list)
firstItem = List.FirstItem(sort)
lowest = Output(firstItem)
