# Dynamo graph GetCurvesFromFamilyInstance.dyn (Dynamo 1.0.1.1803)

select_model_element = DSModelElementSelection()
curves = Element.Curves(select_model_element, lacing=Longest)
geometry = Element.Geometry(curves)
number = DoubleInput(1)
pointAtParameter = Curve.PointAtParameter(curve=geometry, param=number, lacing=Longest)
select_model_elements = DSModelElementsSelection()
point = ReferencePoint.Point(select_model_elements, lacing=Longest)
number_2 = DoubleInput(1)
shiftIndices = List.ShiftIndices(list=point, amount=number_2)
reverse = List.Reverse(shiftIndices)
distanceTo = Geometry.DistanceTo(geometry=pointAtParameter, other=reverse, lacing=Longest)
number_3 = DoubleInput(0.001)
length = DynamoUnits.Length.FromDouble(number_3, lacing=Longest)
lessThan = Compare.LessThan(arg1=length)
filter = Filter(distanceTo, lessThan)
watch = Watch(number_3)
